# Grasshopper definition CAADRIA_EarthyIndex_2_Visualization.gh (Grasshopper 1.0.7)
# plug-ins: Hops, Human

construct_domain = ConstructDomain(DomainStart="-23", DomainEnd="-22.5")
construct_domain_2 = ConstructDomain(DomainStart="-43.0", DomainEnd="-43.185796")
rectangle = Rectangle(Plane=PlaneXY(0, 0, 0), XSize=construct_domain_2, YSize=construct_domain, Radius=0)  # -> Rectangle, Length
cluster = Cluster_2()
cluster_2 = Cluster_3(C=cluster)
control_points = ControlPoints(Curve=rectangle.Rectangle)  # -> Points, Weights, Knots
ghpython_script = GhPythonScript(x=control_points.Points)  # -> a; inputs x: list
# ---------- ghpython_script: Python ----------
__author__ = "johanes"
__version__ = "2023.02.09"

import rhinoscriptsyntax as rs

a = x[:-1]
# ---------- end ghpython_script ----------
pt = Point(cluster_2)  # disabled
panel = Panel("""recurrence
seasonality
max_extent""")
pt_2 = Point(ghpython_script)
hops = Hops(
    Points=ghpython_script,
    Bool=Toggle(False),
    CacheResultsInMemory=False,
    CacheSolveResults=True,
    RemoteDefinitionLocation="http://127.0.0.1:5000/reproject_UTM",
    RemoteSolveVersion=(0, 1, 0),
    ShowInput_Enabled=False,
    ShowInput_Path=False,
    SynchronousSolve=True)
hops_2 = Hops(
    _Enabled=Toggle(True),
    Layer="JRC/GSW1_3/GlobalSurfaceWater",
    Bands="occurrence",
    Mode="mean",
    Scale=Slider(300, range=0..1000),
    Pts=ghpython_script,
    CacheResultsInMemory=False,
    CacheSolveResults=True,
    RemoteDefinitionLocation="http://127.0.0.1:5000/ee_image",
    RemoteSolveVersion=(0, 1, 0),
    ShowInput_Enabled=True,
    ShowInput_Path=False,
    SynchronousSolve=True)  # -> Values, W, H
hops_3 = Hops(
    Points=pt_2,
    Bool=Toggle(False),
    CacheResultsInMemory=False,
    CacheSolveResults=True,
    RemoteDefinitionLocation="http://127.0.0.1:5000/reproject_UTM",
    RemoteSolveVersion=(0, 1, 0),
    ShowInput_Enabled=False,
    ShowInput_Path=False,
    SynchronousSolve=True)
hops_4 = Hops(
    Layer="JRC/GSW1_3/GlobalSurfaceWater",
    Bands=panel,
    Mode="mean",
    Scale=Slider(300, range=0..1000),
    Pts=ghpython_script,
    CacheResultsInMemory=False,
    CacheSolveResults=True,
    RemoteDefinitionLocation="http://127.0.0.1:5000/ee_image",
    RemoteSolveVersion=(0, 1, 0),
    ShowInput_Enabled=False,
    ShowInput_Path=False,
    SynchronousSolve=True)  # -> Values, W, H
pline = PolyLine(Vertices=reverse(hops), Closed=invert(False))
pline_2 = PolyLine(Vertices=reverse(hops_3), Closed=invert(False))
item = ListItem(List=hops_4.W, Index=0, Wrap=True)
item_2 = ListItem(List=hops_4.H, Index=0, Wrap=True)
mplane = MeshPlane(Boundary=pline, WidthCount=expr("x-1", hops_2.W), HeightCount=expr("x-1", hops_2.H))  # -> Mesh, Area
multiplication = Multiplication(A=item, B=item_2)
mplane_2 = MeshPlane(Boundary=pline_2, WidthCount=expr("x-1", item), HeightCount=expr("x-1", item_2))  # -> Mesh, Area
bnd = Bounds(Numbers=hops_2.Values)
demesh = DeconstructMesh(Mesh=mplane.Mesh)  # -> Vertices, Faces, Colours, Normals
dedomain = DeconstructDomain(Domain=bnd)  # -> Start, End
bnd_2 = Bounds(Numbers=hops_4.Values)
gradient = Gradient(
    LowerLimit=dedomain.Start,
    UpperLimit=dedomain.End,
    Parameter=hops_2.Values,
    stops=[0: RGB(172, 220, 250), 1: RGB(61, 54, 186)])
remap = RemapNumbers(Value=hops_4.Values, Source=bnd_2, Target="1")  # -> Mapped, Clipped
demesh_2 = DeconstructMesh(Mesh=mplane_2.Mesh)  # -> Vertices, Faces, Colours, Normals
mesh_colours = MeshColours(Mesh=mplane.Mesh, Colours=gradient)
bang = ExplodeTree(Data=remap.Mapped)  # -> Branch0, Branch1, Branch2
larger = LargerThan(FirstNumber=hops_2.Values, SecondNumber=Slider(30, range=0..100))  # -> LargerThan, OrEqualTo
gradient_2 = Gradient(LowerLimit=0, UpperLimit=1, Parameter=bang.Branch0, stops=[0.5: RGB(186, 54, 83), 1: RGB(127, 135, 223)])
cull = CullPattern(List=demesh.Vertices, CullPattern=larger.LargerThan)
dash = DashPattern(Curve=pline, Pattern=Slider(500, range=0..10000))  # -> Dashes, Gaps
multiplication_2 = Multiplication(A=hops_2.Values, B=Slider(1, range=0..1000))
qt = QuadTree(Points=cull, Plane=PlaneXY(0, 0, 0), Square=invert(False), Group=5)  # -> Quads, Points
multiplication_3 = Multiplication(A=bang.Branch0, B=Slider(90, range=0..1000))
multiplication_4 = Multiplication(A=bang.Branch0, B=Slider(500, range=0..1000))
Y = UnitY(Factor=1)
Z = UnitZ(Factor=1)
cir = Circle(Plane=demesh.Vertices, Radius=multiplication_2)
vrot = Rotate(Vector=Y, Axis=Z, Angle=degrees(multiplication_3))
number_slider = Slider(1, range=0..2)
partition_list = PartitionList(List=multiplication_4, Size=multiplication)
partition_list_2 = PartitionList(List=vrot, Size=multiplication)

previewlw = CustomPreviewLineweights(Geometry=cir, Shader=gradient, Absolute=False)
previewlw_2 = CustomPreviewLineweights(Geometry=qt.Quads, Shader=ColourSwatch(SwatchColor=RGB(255, 0, 0)), Absolute=False)
previewlw_3 = CustomPreviewLineweights(Geometry=dash.Dashes, Shader=ColourSwatch(SwatchColor=RGB(0, 0, 0)), Absolute=False)

param_viewer = ParamViewer(partition_list)
param_viewer_2 = ParamViewer(partition_list_2)
list_item = ListItem(List=param_viewer, Index=number_slider, Wrap=True)
list_item_2 = ListItem(List=param_viewer_2, Index=number_slider, Wrap=True)
tree_branch = TreeBranch(Tree=partition_list, Path=list_item, MaintainPaths=True)
tree_branch_2 = TreeBranch(Tree=partition_list_2, Path=list_item_2, MaintainPaths=True)
partition_list_3 = PartitionList(List=gradient_2, Size=multiplication)
param_viewer_3 = ParamViewer(partition_list_3)
list_item_3 = ListItem(List=param_viewer_3, Index=number_slider, Wrap=True)
tree_branch_3 = TreeBranch(Tree=partition_list_3, Path=list_item_3, MaintainPaths=True)
line = LineSDL(Start=demesh_2.Vertices, Direction=tree_branch_2, Length=tree_branch)
previewlw_4 = CustomPreviewLineweights(Geometry=line, Shader=tree_branch_3, Thickness=Slider(2, range=0..10), Absolute=False)

# ==== cluster Cluster_2
cluster = Cluster()
crv = ClusterOutput(cluster)

# ==== cluster Cluster_3
C = ClusterInput()
disc = Discontinuity(Curve=C, Level=1)  # -> Points, Parameters
P = ClusterOutput(disc.Points)

# ==== cluster Cluster
crv = Curve(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)  # disabled
crv_2 = ClusterOutput(crv)
