# Grasshopper definition CAADRIA_EarthyIndex_3_CumulativeCost.gh (Grasshopper 1.0.7)
# plug-ins: Hops

bb_split = Bb_split(bb_coordinate="106.622093,-6.473585,107.043023,-5.96962")  # -> west, east, south, north
construct_domain = ConstructDomain(DomainStart=bb_split.south, DomainEnd=bb_split.north)
construct_domain_2 = ConstructDomain(DomainStart=bb_split.west, DomainEnd=bb_split.east)
remap_numbers = RemapNumbers(Value=Slider(0.5, range=0..1), Source=Domain(0, 1), Target=construct_domain_2)  # -> Mapped, Clipped
remap_numbers_2 = RemapNumbers(Value=Slider(0.5, range=0..1), Source=Domain(0, 1), Target=construct_domain)  # -> Mapped, Clipped
rectangle = Rectangle(Plane=PlaneXY(0, 0, 0), XSize=construct_domain_2, YSize=construct_domain, Radius=0)  # -> Rectangle, Length
construct_point = ConstructPoint(XCoordinate=remap_numbers.Mapped, YCoordinate=remap_numbers_2.Mapped, ZCoordinate=0)
control_points = ControlPoints(Curve=rectangle.Rectangle)  # -> Points, Weights, Knots
ghpython_script = GhPythonScript(x=control_points.Points)  # -> a; inputs x: list
# ---------- ghpython_script: Python ----------
__author__ = "johanes"
__version__ = "2023.02.09"

import rhinoscriptsyntax as rs

a = x[:-1]
# ---------- end ghpython_script ----------
crv = Curve(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)
disc = Discontinuity(Curve=crv, Level=1)  # -> Points, Parameters
toggle = BooleanToggle(False)
pt = Point(ghpython_script)
pt_2 = Point(construct_point)

# ----
# .../ee_cumCost
hops = Hops(
    Layer="Oxford/MAP/friction_surface_2019",
    Cost="friction",
    Sources=pt_2,
    Maxdistance=Slider(30000, range=0..100000),
    Scale=Slider(250, range=0..1000),
    Bbox=ghpython_script,
    CacheResultsInMemory=True,
    CacheSolveResults=True,
    RemoteDefinitionLocation="http://127.0.0.1:5000/ee_cumCost",
    RemoteSolveVersion=(0, 1, 0),
    ShowInput_Enabled=False,
    ShowInput_Path=False,
    SynchronousSolve=False)  # -> Values, W, H

# ----
# .../reproject_UTM
hops_2 = Hops(
    Points=pt,
    Bool=toggle,
    CacheResultsInMemory=True,
    CacheSolveResults=True,
    RemoteDefinitionLocation="http://127.0.0.1:5000/reproject_UTM",
    RemoteSolveVersion=(0, 1, 0),
    ShowInput_Enabled=False,
    ShowInput_Path=False,
    SynchronousSolve=True)

hops_3 = Hops(
    Points=construct_point,
    Bool=toggle,
    CacheResultsInMemory=True,
    CacheSolveResults=True,
    RemoteDefinitionLocation="http://127.0.0.1:5000/reproject_UTM",
    RemoteSolveVersion=(0, 1, 0),
    ShowInput_Enabled=False,
    ShowInput_Path=False,
    SynchronousSolve=True)
point = Point(hops_3)
pline = PolyLine(Vertices=reverse(hops_2), Closed=invert(False))
bnd = Bounds(Numbers=hops.Values)
mplane = MeshPlane(Boundary=pline, WidthCount=expr("x-1", hops.W), HeightCount=expr("x-1", hops.H))  # -> Mesh, Area
dedomain = DeconstructDomain(Domain=bnd)  # -> Start, End
demesh = DeconstructMesh(Mesh=mplane.Mesh)  # -> Vertices, Faces, Colours, Normals
gradient = Gradient(
    LowerLimit=dedomain.Start,
    UpperLimit=Slider(42, range=0..100),
    Parameter=hops.Values,
    stops=[0: RGB(255, 255, 0), 1: RGB(61, 54, 186)])
Z = UnitZ(Factor=hops.Values)
move = Move(Geometry=demesh.Vertices, Motion=Z)  # -> Geometry, Transform
conmesh = ConstructMesh(Vertices=move.Geometry, Faces=demesh.Faces, Colours=gradient)
contour = Contour(Shape=conmesh, Point=Point(0, 0, 0), Direction=Vector(0, 0, 1), Distance=Slider(5, range=0..100))

# ==== cluster Bb_split
bb_coordinate = ClusterInput()
text_split = TextSplit(Text=bb_coordinate, Separators=",")
list_item = ListItem(List=text_split, Index=0, Wrap=True)
list_item_2 = ListItem(List=text_split, Index=2, Wrap=True)
list_item_3 = ListItem(List=text_split, Index=1, Wrap=True)
list_item_4 = ListItem(List=text_split, Index=3, Wrap=True)
east = ClusterOutput(list_item_2)
south = ClusterOutput(list_item_3)
west = ClusterOutput(list_item)
north = ClusterOutput(list_item_4)
