# Grasshopper definition CAADRIA_EarthyIndex_4_CityImpact.gh (Grasshopper 1.0.7)
# plug-ins: Hops

# In order to run the script
# 
# 1_update the link of the Geonames file with the one you downloaded
# 
# 2_replace the url of the Hops component if you are running it through Colab
geonames_cities15000_csv = FilePath("G:\My Drive\EPFL\Studio\Spring 2023\GEONAMES_cities15000.csv")
file = ReadFile(File=geonames_cities15000_csv, PerLineParse=True)
split = TextSplit(Text=file, Separators=",")  # -> simplify(Result)
split_2 = SplitTree(Data=split, Masks=flatten("{0}"))  # -> Positive, Negative
item = ListItem(List=split_2.Negative, Index="6", Wrap=True)
panel = Panel(split_2.Positive)
item_2 = ListItem(List=split_2.Negative, Index="3", Wrap=True)  # -> Item, Item1
item_3 = ListItem(List=split_2.Negative, Index="1", Wrap=True)
pt = ConstructPoint(XCoordinate=item_2.Item1, YCoordinate=item_2.Item, ZCoordinate=0)
mindex = MemberIndex(Set=item_3, Member="Turin")  # -> Index, Count
panel_2 = Panel(item_2.Item)
panel_3 = Panel(item_2.Item1)
item_4 = ListItem(List=pt, Index=mindex.Index, Wrap=True)  # -> flatten(Item)
item_5 = ListItem(List=item, Index=mindex.Index, Wrap=True)  # -> flatten(Item)
item_6 = ListItem(List=item_4, Index=0, Wrap=True)
rectangle = Rectangle(Plane=item_6, XSize="-2 to 2", YSize="-1.2 to 1.2", Radius=0)  # -> Rectangle, Length
cir = Circle(Plane=item_6, Radius=Slider(1.5, range=0..10))
item_7 = ListItem(List=item_5, Index=0, Wrap=True)
bbox = BoundingBox(Content=rectangle.Rectangle, Plane=PlaneXY(0, 0, 0))  # -> Box, Box_2
rec = Rectangle(bbox.Box)
incurve = PointInCurve(Point=pt, Curve=rec)  # -> Relationship, Point
disc = Discontinuity(Curve=rec, Level=1)  # -> Points, Parameters
cull = CullPattern(List=pt, CullPattern=incurve.Relationship)  # -> flatten(List)
cull_2 = CullPattern(List=item, CullPattern=incurve.Relationship)  # -> flatten(List)
merge = Merge(Data1=flatten(disc.Points), Data2=flatten(item_6), Data3=flatten(cull))
merge_2 = Merge(Data1=flatten(item_7), Data2=flatten(cull_2))
population = Data(merge_2)
scale = Slider(700, range=0..1000)

m2 = Panel("(m2*pop)/(scale)^2")
multiplication = Multiplication(A="326.21", B=Slider(17, range=0..100))
eval = Evaluate(F=m2, m2=multiplication, pop=item_7, scale=scale)

_1_hectare_10_000_m2 = Panel("(ha*pop)/(scale/100)^2")
pt_2 = Point(disc.Points)
pt_3 = Point(item_6)
pt_4 = Point(merge)
eval_2 = Evaluate(F=_1_hectare_10_000_m2, ha=Slider(0.2, range=0..1), pop=item_7, scale=scale)

# ----
# .../reproject_UTM
hops = Hops(
    Points=pt_4,
    Bool=Toggle(True),
    CacheResultsInMemory=True,
    CacheSolveResults=True,
    RemoteDefinitionLocation="http://127.0.0.1:5000/reproject_UTM",
    RemoteSolveVersion=(0, 1, 0),
    ShowInput_Enabled=False,
    ShowInput_Path=False,
    SynchronousSolve=True)

# ----
# .../ee_image
hops_2 = Hops(
    _Enabled=Toggle(True),
    Layer="ESA/GLOBCOVER_L4_200901_200912_V2_3",
    Bands="landcover",
    Mode="mode",
    Scale=scale,
    Pts=disc.Points,
    CacheResultsInMemory=True,
    CacheSolveResults=True,
    RemoteDefinitionLocation="http://127.0.0.1:5000/ee_image",
    RemoteSolveVersion=(0, 1, 0),
    ShowInput_Enabled=True,
    ShowInput_Path=False,
    SynchronousSolve=True)  # -> Values, W, H

# ----
# .../ee_cumCost
hops_3 = Hops(
    Layer="Oxford/MAP/friction_surface_2019",
    Cost="friction",
    Sources=pt_3,
    Maxdistance="200000",
    Scale=scale,
    Bbox=pt_2,
    CacheResultsInMemory=True,
    CacheSolveResults=True,
    RemoteDefinitionLocation="http://127.0.0.1:5000/ee_cumCost",
    RemoteSolveVersion=(0, 1, 0),
    ShowInput_Enabled=False,
    ShowInput_Path=False,
    SynchronousSolve=False)  # -> Values, W, H

point = Point(merge)
split_3 = SplitList(List=hops, Index="4")  # -> ListA, ListB
cost = Data(hops_3.Values)
pline = PolyLine(Vertices=reverse(split_3.ListA), Closed=invert(False))
cities = Point(split_3.ListB)
bnd = Bounds(Numbers=cost)
mplane = MeshPlane(Boundary=pline, WidthCount=expr("x-1", hops_2.W), HeightCount=expr("x-1", hops_2.H))  # -> Mesh, Area
mplane_2 = MeshPlane(Boundary=pline, WidthCount=expr("x-1", hops_3.W), HeightCount=expr("x-1", hops_3.H))  # -> Mesh, Area
dedomain = DeconstructDomain(Domain=bnd)  # -> Start, End
wheel = ColourWheel(
    "230",
    ColourGrips_Style=20,
    ColourGrips_Grip=[5.740058888, 1.744010599, 4.188790205, 3.141592654],
    ColourGrips_Lum=[0.5767573598, 0.9927662536],
    ColourGrips_Range=[0.408079655, 0.2617993878, 0.2617993878, 0.2617993878],
    ColourGrips_Sat=[0.5177716396, 0.8387170448])
gradient = Gradient(LowerLimit=dedomain.Start, UpperLimit=dedomain.End, Parameter=cost, stops=[0: RGB(255, 255, 255), 1: RGB(0, 0, 0)])
demesh = DeconstructMesh(Mesh=mplane_2.Mesh)  # -> Vertices, Faces, Colours, Normals
Z = UnitZ(Factor=cost)
demesh_2 = DeconstructMesh(Mesh=mplane.Mesh)  # -> Vertices, Faces, Colours, Normals
move = Move(Geometry=demesh.Vertices, Motion=Z)  # -> Geometry, Transform
fdom = FindDomain(Domains="100 to 150", Number=hops_2.Values, Strict=False)  # -> Index, Neighbour
item_8 = ListItem(List=wheel, Index=hops_2.Values, Wrap=True)
addition = Addition(A=fdom.Index, B="1")
conmesh = ConstructMesh(Vertices=move.Geometry, Faces=demesh.Faces, Colours=gradient)
conmesh_2 = ConstructMesh(Vertices=demesh_2.Vertices, Faces=demesh_2.Faces, Colours=item_8)
cost_2 = Data(cost)
bool = Boolean(addition)
multiplication_2 = Multiplication(A=cost_2, B=bool)
contour = Contour(Shape=conmesh, Point=Point(0, 0, 0), Direction=Vector(0, 0, 1), Distance=Slider(10, range=0..10))
sort = SortList(Keys=multiplication_2, ValuesA=demesh_2.Vertices)  # -> Keys, ValuesA
threshold = Number(eval)
cull_3 = CullPattern(List=sort.ValuesA, CullPattern=sort.Keys)
cull_4 = CullPattern(List=sort.Keys, CullPattern=sort.Keys)
item_9 = ListItem(List=cull_4, Index=threshold, Wrap=True)
split_4 = SplitList(List=cull_3, Index=threshold)  # -> ListA, ListB
threshold_cost = Number(item_9)
larger = LargerThan(FirstNumber=cost_2, SecondNumber=threshold_cost)  # -> LargerThan, OrEqualTo
consumed_land = Point(split_4.ListA)
cullv = CullVertices(Mesh=conmesh_2, Pattern=larger.LargerThan, Shrink=True)
cities_2 = Data(cities)
population_2 = Data(merge_2)
faceb = FaceBoundaries(Mesh=mplane.Mesh)
hull = ConvexHull(Points=consumed_land, Plane=PlaneXY(0, 0, 0))  # -> Hull, HullZ, Indices
move_2 = Move(Geometry=cities_2, Motion=Vector(0, 0, 10))  # -> Geometry, Transform
item_10 = ListItem(List=faceb, Index=0, Wrap=True)
project = ProjectPoint(Point=move_2.Geometry, Direction=Vector(0, 0, -1), Geometry=cullv)  # -> Point, Index
area = Area(Geometry=item_10)  # -> Area, Centroid
clean = CleanTree(
    RemoveNulls=True,
    RemoveInvalid=True,
    RemoveEmpty=invert(False),
    Tree=simplify(graft(project.Point)),
    SynchronousTree1=simplify(graft(population_2)))  # -> flatten(Tree), flatten(SynchronousTree1)
number_slider = Slider(0.1, range=0..1)
vec2pt = Vector2Pt(PointA=area.Centroid, PointB=consumed_land, Unitize=False)  # -> Vector, Length
number_slider_2 = Slider(0.01, range=0..0.01)
move_3 = Move(Geometry=item_10, Motion=vec2pt.Vector)  # -> Geometry, Transform
cluster = Cluster(C=cullv)  # -> num_2, C_2, pt_2
multiplication_3 = Multiplication(A=clean.SynchronousTree1, B=Slider(0.05, range=0..0.1))
cir_2 = Circle(Plane=clean.Tree, Radius=multiplication_3)
num = Number(cluster.num_2)
crv = Curve(cluster.C_2)
divide = DivideCurve(Curve=cir_2, Count="4", Kinks=False)  # -> Points, Tangents, Parameters
explode = Explode(Curve=hull.Hull, Recursive=True)  # -> Segments, Vertices
eval_3 = Evaluate(F="round(x/1000) & \" km\"", x=num)
len = Length(Curve=explode.Segments)
sort_2 = SortList(Keys=len, ValuesA=explode.Segments)  # -> Keys, ValuesA
dispatch = Dispatch(List=divide.Points, DispatchPattern=[True, False])  # -> ListA, ListB
panel_4 = Panel("""500
1500""")
dash = DashPattern(Curve=cir_2, Pattern="150")  # -> Dashes, Gaps
split_5 = SplitList(List=reverse(sort_2.ValuesA), Index="4")  # -> ListA, ListB
dash_2 = DashPattern(Curve=hull.Hull, Pattern="500")  # -> Dashes, Gaps
dash_3 = DashPattern(Curve=contour, Pattern=panel_4)  # -> Dashes, Gaps
pline_2 = PolyLine(Vertices=dispatch.ListA, Closed=False)
pline_3 = PolyLine(Vertices=dispatch.ListB, Closed=False)
panel_5 = Panel("""500
1500""")
curvepoint = PointOnCurve(split_5.ListA, parameter=0.5)
len_2 = Length(Curve=split_5.ListA)
swatch = ColourSwatch(SwatchColor=RGB(0, 0, 0))
merge_3 = Merge(Data1=pline_2, Data2=pline_3)
dash_4 = DashPattern(Curve=crv, Pattern=panel_5)  # -> Dashes, Gaps
entwine = Entwine(Branch00="2", Branch01="1", FlattenInputs=True)
eval_4 = Evaluate(F="round(x/1000) & \" km\"", x=len_2)

c_script = CSharpScript(T=eval_4, P=curvepoint)  # -> out, A; inputs T: String, P: Point3d
# ---------- c_script: C# usings ----------
using System.IO;
using System.Linq;
using System.Data;
using System.Drawing;
using System.Reflection;
using System.Windows.Forms;
using System.Xml;
using System.Xml.Linq;
using System.Runtime.InteropServices;

using Rhino.DocObjects;
using Rhino.Collections;
using GH_IO;
using GH_IO.Serialization;
# ---------- c_script: C# ----------
    _text.Add(T);
    _points.Add(P);
# ---------- c_script: C# additional code ----------
  private readonly List<string> _text = new List<string>();
  private readonly List<Point3d> _points = new List<Point3d>();

  /// <summary>
  /// This method will be called once every solution, before any calls to RunScript.
  /// </summary>
  public override void BeforeRunScript()
  {
    _text.Clear();
    _points.Clear();
  }

  //Draw all meshes in this method.
  public override void DrawViewportMeshes(IGH_PreviewArgs args)
  {
    for (int i = 0; i < _text.Count; i++)
    {
      Plane plane ;
      args.Viewport.GetCameraFrame(out plane);
      plane.Origin = _points[i];

      double pixelsPerUnit ;
      args.Viewport.GetWorldToScreenScale(_points[i], out pixelsPerUnit);

      args.Display.Draw3dText(_text[i], Color.Black, plane, 10 / pixelsPerUnit, "Roboto Mono");
    }
  }
# ---------- end c_script ----------
curve_display = CSharpScript(Curve=merge_3, Width=entwine, Colour=swatch)  # inputs Curve: Curve, Width: Int32, Colour: Color, Dash: String
# ---------- curve_display: C# ----------
    if (Curve == null) return;
    if (Width <= 0) return;

    double[] pattern = ParseDashPattern(Dash);
    IEnumerable<Curve> segments = ApplyDashPattern(Curve, pattern);

    _clip = BoundingBox.Union(_clip, Curve.GetBoundingBox(false));
    foreach (Curve segment in segments)
    {
      _curves.Add(segment);
      _colors.Add(Colour);
      _widths.Add(Width);
    }
# ---------- curve_display: C# additional code ----------
  /// <summary>
  /// Parse a dash pattern.
  /// </summary>
  /// <param name="pattern">Pattern to parse.</param>
  /// <returns>Array of dashes and gaps.</returns>
  private double[] ParseDashPattern(string pattern)
  {
    if (string.IsNullOrWhiteSpace(pattern))
      return null;

    string[] fragments = pattern.Split(new char[] {' '});
    if (fragments == null || fragments.Length == 0)
      return null;

    double[] values = new double[fragments.Length];
    for (int i = 0; i < fragments.Length; i++)
    {
      double v;
      if (!double.TryParse(fragments[i], out v))
        throw new Exception(fragments[i] + " is a not a valid number.");

      if (v <= 0.0)
        throw new Exception("Dashes or gaps must have a strictly positive length.");

      values[i] = v;
    }

    return values;
  }
  /// <summary>
  /// Apply a dash+gap pattern to a curve.
  /// </summary>
  private IEnumerable<Curve> ApplyDashPattern(Curve curve, double[] pattern)
  {
    if (pattern == null || pattern.Length == 0)
      return new Curve[] { curve };

    double curveLength = curve.GetLength();
    List<Curve> dashes = new List<Curve>();

    double offset0 = 0.0;
    int index = 0;
    while(true)
    {
      // Get the current dash length.
      double dashLength = pattern[index++];
      if (index >= pattern.Length)
        index = 0;

      // Compute the offset of the current dash from the curve start.
      double offset1 = offset0 + dashLength;
      if (offset1 > curveLength)
        offset1 = curveLength;

      // Solve the curve parameters at the current dash start and end.
      double t0, t1;
      curve.LengthParameter(offset0, out t0);
      curve.LengthParameter(offset1, out t1);

      Curve dash = curve.Trim(t0, t1);
      if (dash != null)
        dashes.Add(dash);

      // Get the current gap length.
      double gapLength = pattern[index++];
      if (index >= pattern.Length)
        index = 0;

      // Set the start of the next dash to be the end of the current
      // dash + the length of the adjacent gap.
      offset0 = offset1 + gapLength;

      // Abort when we've reached the end of the curve.
      if (offset0 >= curveLength)
        break;
    }

    return dashes;
  }

  private BoundingBox _clip;
  private readonly List<Curve> _curves = new List<Curve>();
  private readonly List<Color> _colors = new List<Color>();
  private readonly List<int> _widths = new List<int>();

  /// <summary>
  /// This method will be called once every solution, before any calls to RunScript.
  /// </summary>
  public override void BeforeRunScript()
  {
    _clip = BoundingBox.Empty;
    _curves.Clear();
    _colors.Clear();
    _widths.Clear();
  }

  /// <summary>
  /// Return a BoundingBox that contains all the geometry you are about to draw.
  /// </summary>
  public override BoundingBox ClippingBox
  {
    get { return _clip; }
  }
  /// <summary>
  /// Draw all wires and points in this method.
  /// </summary>
  public override void DrawViewportWires(IGH_PreviewArgs args)
  {
    for (int i = 0; i < _curves.Count; i++)
      args.Display.DrawCurve(_curves[i], _colors[i], _widths[i]);
  }
# ---------- end curve_display ----------
c_script_2 = CSharpScript(T=eval_3, P=cluster.pt_2)  # -> out, A; inputs T: String, P: Point3d; same code as c_script
preview = CustomPreview(Geometry=dash_3.Dashes, Material=ColourSwatch(SwatchColor=RGB(189, 189, 189)))
preview_2 = CustomPreview(Geometry=dash_2.Dashes, Material=ColourSwatch(SwatchColor=RGB(0, 0, 0)))
preview_3 = CustomPreview(Geometry=move_3.Geometry, Material=ColourSwatch(SwatchColor=RGB(110, 134, 255)))
preview_4 = CustomPreview(Geometry=dash.Dashes, Material=swatch)
mesh = Mesh(cullv)
preview_5 = CustomPreview(Geometry=dash_4.Dashes, Material=ColourSwatch(SwatchColor=RGB(0, 42, 255)))

# ==== cluster Cluster
C = ClusterInput()
bbox = BoundingBox(Content=C, Plane=PlaneXY(0, 0, 0))  # -> Box, Box_2
rec = Rectangle(bbox.Box)
explode = Explode(Curve=rec, Recursive=True)  # -> Segments, Vertices
len = Length(Curve=explode.Segments)
split = TextSplit(Text=len, Separators=".")
area = Area(Geometry=rec)  # -> Area, Centroid
item = ListItem(List=split, Index=0, Wrap=True)
sort = SortList(Keys=flatten(item))  # -> reverse(Keys), ValuesA
len_2 = TextLength(Text=sort.Keys)
item_2 = ListItem(List=len_2, Index=0, Wrap=True)
item_3 = ListItem(List=sort.Keys, Index=0, Wrap=True)
subtraction = Subtraction(A=item_2, B="1")
pow = Power(A="10", B=subtraction)
division = Division(A=pow, B="2")
mod = Modulus(A=item_3, B=division)
panel = Panel(division)
subtraction_2 = Subtraction(A=item_3, B=mod)
dom = ConstructDomain(DomainStart=expr("-x/2", subtraction_2), DomainEnd=expr("x/2", subtraction_2))
num = Number(panel)
num_2 = ClusterOutput(num)
box = DomainBox(Base=area.Centroid, X=dom, Y=dom, Z=Domain(0, 0.25))
rec_2 = Rectangle(box)
boundary = BoundarySurfaces(Edges=rec_2)
explode_2 = Explode(Curve=rec_2, Recursive="2")  # -> Segments, Vertices
split_2 = SplitList(List=explode_2.Segments, Index="2")  # -> ListA, ListB
ext = ExtendCurve(Curve=split_2.ListA, Type=0, Start="10", End="10")
yz = YZPlane(Origin=Point(0, 0, 0))
xz = XZPlane(Origin=Point(0, 0, 0))
divlength = DivideLength(Curve=ext, Length=division)  # -> Points, Tangents, Parameters
cull_i = CullIndex(List=divlength.Points, Indices="0", Wrap=True)
cull_i_2 = CullIndex(List=reverse(cull_i), Indices="0", Wrap=True)  # -> reverse(List)
merge = Merge(Data1=yz, Data2=xz)  # -> graft(Result)
pl_origin = PlaneOrigin(Base=merge, Origin=cull_i_2)
sec = BrepPlane(Brep=boundary, Plane=pl_origin)  # -> flatten(Curves), Points
len_3 = Length(Curve=sec.Curves)
multiplication = Multiplication(A=len_3, B="0.05")
ext_2 = ExtendCurve(Curve=sec.Curves, Type=0, Start=multiplication, End=multiplication)
item_4 = ListItem(List=ext_2, Index=0, Wrap=True)
eval = EvaluateCurve(Curve=reparameterize(item_4), Parameter="1")  # -> Point, Tangent, Angle
pt = Point(eval.Point)
pt_2 = ClusterOutput(pt)
C_2 = ClusterOutput(ext_2)
